# Grasshopper definition Generative Design Project 3D Model Grasshopper code.gh (Grasshopper 1.0.7)

# This causes the spiral to slim down
number_slider = Slider(3, range=0..10)
# This causes the number of spirals per layer to increase
number_slider_2 = Slider(30, range=0..100)
# This causes the spiral to rotate slightly
phase = Slider(83, range=0..1000)
# This causes the spiral to slim down 2
number_slider_3 = Slider(10, range=0..10)
# This causes the spiral to morph
number_slider_4 = Slider(15, range=0..100)
# Controls
# This causes the model to grow up and down
# Default parameters:
# Up/down: 313
# OuterCylinder: 3
# Innerwhitecylinder: 2
# Morph: 15
# Slimdown: 3
# Slimdown2: 10
# Rotate: 83
# NumberofSpirals: 30
number_slider_5 = Slider(313, range=1..313)
# This causes only the outer cylinder to grow up and down
# This causes only the inner white cylinder to grow up and down
number_slider_6 = Slider(3, range=0..10)
multiplication = Multiplication(A=Slider(2, range=0..10), B=number_slider_4)
division = Division(A=number_slider_5, B=number_slider_6)
division_2 = Division(A=number_slider_5, B=Slider(2, range=0..10))

cycles = Slider(73, range=0..100)
radius = Slider(87, range=0..100)
phase_2 = Slider(83.428, range=0..100)

cycles_2 = Slider(73, range=0..100)
radius_2 = Slider(70, range=0..100)
phase_3 = Slider(83.428, range=0..100)

radius_3 = Slider(52, range=0..100)
cycles_3 = Slider(73, range=0..100)
phase_4 = Slider(83.428, range=0..100)

radius_4 = Slider(36, range=0..100)
cycles_4 = Slider(73, range=0..100)
phase_5 = Slider(83.428, range=0..100)

# ---- group: Circle
cycles_5 = Slider(73, range=0..100)
radius_5 = Slider(100, range=0..200)
phase_6 = Slider(83.428, range=0..100)

# ----
cycles_6 = Slider(73, range=0..100)
radius_6 = Slider(36, range=36..100)
phase_7 = Slider(83.428, range=0..100)

# ---- group: Circle
radius_7 = Slider(24, range=0..100)
cycles_7 = Slider(73, range=0..100)
phase_8 = Slider(83.428, range=0..100)

# ---- group: Normalising
series = Series(Start=0, Step=1, Count=number_slider_2)
expression = Expression(i=series, n=number_slider_2, Expression="i / ( n - 1 )")

# ----
count = Slider(29, range=3..100)
expression_2 = Expression(r=radius, c=cycles, t=expression, p=phase, Expression="r * cos( 2 * π * c * t + p )")
expression_3 = Expression(r=radius, c=cycles, t=expression, p=phase, Expression="r * sin( 2 * π * c * t + p )")
construct_point = ConstructPoint(XCoordinate=expression_2, YCoordinate=expression_3, ZCoordinate=0)

# ---- group: Normalising
series_2 = Series(Start=0, Step=1, Count=number_slider_2)
expression_4 = Expression(i=series_2, n=number_slider_2, Expression="i / ( n - 1 )")

# ----
count_2 = Slider(29, range=3..100)
expression_5 = Expression(r=radius_2, c=cycles_2, t=expression_4, p=phase, Expression="r * cos( 2 * π * c * t + p )")
expression_6 = Expression(r=radius_2, c=cycles_2, t=expression_4, p=phase, Expression="r * sin( 2 * π * c * t + p )")
construct_point_2 = ConstructPoint(XCoordinate=expression_5, YCoordinate=expression_6, ZCoordinate=0)

# ---- group: Normalising
series_3 = Series(Start=0, Step=1, Count=number_slider_2)
expression_7 = Expression(i=series_3, n=number_slider_2, Expression="i / ( n - 1 )")

# ----
count_3 = Slider(29, range=3..100)
expression_8 = Expression(r=radius_3, c=cycles_3, t=expression_7, p=phase, Expression="r * cos( 2 * π * c * t + p )")
expression_9 = Expression(r=radius_3, c=cycles_3, t=expression_7, p=phase, Expression="r * sin( 2 * π * c * t + p )")
construct_point_3 = ConstructPoint(XCoordinate=expression_8, YCoordinate=expression_9, ZCoordinate=0)

# ---- group: Circle / Normalising
series_4 = Series(Start=0, Step=1, Count=number_slider_2)
expression_10 = Expression(i=series_4, n=number_slider_2, Expression="i / ( n - 1 )")

# ---- group: Circle
# Adjust these sliders and observe the result
# Adjust these sliders and observe the result
count_4 = Slider(30, range=3..100)
expression_11 = Expression(r=radius_5, c=cycles_5, t=expression_10, p=phase, Expression="r * cos( 2 * π * c * t + p )")
expression_12 = Expression(r=radius_5, c=cycles_5, t=expression_10, p=phase, Expression="r * sin( 2 * π * c * t + p )")
construct_point_4 = ConstructPoint(XCoordinate=expression_11, YCoordinate=expression_12, ZCoordinate=0)

# ---- group: Normalising
series_5 = Series(Start=0, Step=1, Count=number_slider_2)
expression_13 = Expression(i=series_5, n=number_slider_2, Expression="i / ( n - 1 )")

# ----
count_5 = Slider(29, range=3..100)
expression_14 = Expression(r=radius_6, c=cycles_6, t=expression_13, p=phase, Expression="r * cos( 2 * π * c * t + p )")
expression_15 = Expression(r=radius_6, c=cycles_6, t=expression_13, p=phase, Expression="r * sin( 2 * π * c * t + p )")
construct_point_5 = ConstructPoint(XCoordinate=expression_14, YCoordinate=expression_15, ZCoordinate=0)

# ---- group: Circle / Normalising
series_6 = Series(Start=0, Step=1, Count=number_slider_2)
expression_16 = Expression(i=series_6, n=number_slider_2, Expression="i / ( n - 1 )")

# ---- group: Circle
# Adjust these sliders and observe the result
# Adjust these sliders and observe the result
count_6 = Slider(29, range=3..100)
expression_17 = Expression(r=radius_7, c=cycles_7, t=expression_16, p=phase, Expression="r * cos( 2 * π * c * t + p )")
expression_18 = Expression(r=radius_7, c=cycles_7, t=expression_16, p=phase, Expression="r * sin( 2 * π * c * t + p )")
construct_point_6 = ConstructPoint(XCoordinate=expression_17, YCoordinate=expression_18, ZCoordinate=0)

# ---- group: Spiral
number_slider_7 = Slider(80, range=0..200)
number_slider_8 = Slider(8.376, range=0..100)
point = Point(Point(436.5356839, -1803.478115, 0))
pi = Pi(Factor=number_slider_4)
offset = Slider(2.875, range=0..10)
offset_2 = Slider(9.858, range=0..10)
range = Range(Domain=pi, Steps=number_slider_7)
panel = Panel(range)
point_polar = PointPolar(BasePlane=point, XYAngle=range, ZAngle=0, Offset=number_slider)
point_polar_2 = PointPolar(BasePlane=point, XYAngle=range, ZAngle=0, Offset=number_slider_3)
range_2 = Range(Domain=division_2, Steps=number_slider_7)
unit_z = UnitZ(Factor=range_2)
move = Move(Geometry=point_polar_2, Motion=unit_z)  # -> Geometry, Transform
move_2 = Move(Geometry=point_polar, Motion=unit_z)  # -> Geometry, Transform
line = Line(StartPoint=move_2.Geometry, EndPoint=move.Geometry)
loft = Loft(Curves=line, Options={Adjust=False, Closed=False, LoftEnds=0, LoftSimp=0, LoftType=0, Rebuild=10, Refit=0.01})
custom_preview = CustomPreview(
    Geometry=loft,
    Material={diffuse=RGB(221, 160, 221), emission=RGB(66, 48, 66), shine=0.5, specular=RGB(255, 255, 255), transparency=0})

number_slider_9 = Slider(80, range=0..200)
number_slider_10 = Slider(25.908, range=0..100)
point_2 = Point(Point(437.0720648, -1658.508332, 0))
pi_2 = Pi(Factor=multiplication)
offset_3 = Slider(2.875, range=0..10)
offset_4 = Slider(9.858, range=0..10)
range_3 = Range(Domain=pi_2, Steps=number_slider_9)
panel_2 = Panel(range_3)
point_polar_3 = PointPolar(BasePlane=point_2, XYAngle=range_3, ZAngle=0, Offset=number_slider)
point_polar_4 = PointPolar(BasePlane=point_2, XYAngle=range_3, ZAngle=0, Offset=number_slider_3)
range_4 = Range(Domain=number_slider_5, Steps=number_slider_9)
unit_z_2 = UnitZ(Factor=range_4)
move_3 = Move(Geometry=point_polar_4, Motion=unit_z_2)  # -> Geometry, Transform
move_4 = Move(Geometry=point_polar_3, Motion=unit_z_2)  # -> Geometry, Transform
line_2 = Line(StartPoint=move_4.Geometry, EndPoint=move_3.Geometry)
loft_2 = Loft(Curves=line_2, Options={Adjust=False, Closed=False, LoftEnds=0, LoftSimp=0, LoftType=0, Rebuild=10, Refit=0.01})
custom_preview_2 = CustomPreview(
    Geometry=loft_2,
    Material={diffuse=RGB(221, 160, 221), emission=RGB(66, 48, 66), shine=0.5, specular=RGB(255, 255, 255), transparency=0})

number_slider_11 = Slider(80, range=0..200)
number_slider_12 = Slider(8.376, range=0..100)
point_3 = Point(Point(279.9557023, -2022.144346, 0))
pi_3 = Pi(Factor=number_slider_4)
offset_5 = Slider(2.875, range=0..10)
offset_6 = Slider(9.858, range=0..10)
range_5 = Range(Domain=pi_3, Steps=number_slider_11)
panel_3 = Panel(range_5)
point_polar_5 = PointPolar(BasePlane=point_3, XYAngle=range_5, ZAngle=0, Offset=number_slider)
point_polar_6 = PointPolar(BasePlane=point_3, XYAngle=range_5, ZAngle=0, Offset=number_slider_3)
range_6 = Range(Domain=division, Steps=number_slider_11)
unit_z_3 = UnitZ(Factor=range_6)
move_5 = Move(Geometry=point_polar_6, Motion=unit_z_3)  # -> Geometry, Transform
move_6 = Move(Geometry=point_polar_5, Motion=unit_z_3)  # -> Geometry, Transform
line_3 = Line(StartPoint=move_6.Geometry, EndPoint=move_5.Geometry)
loft_3 = Loft(Curves=line_3, Options={Adjust=False, Closed=False, LoftEnds=0, LoftSimp=0, LoftType=0, Rebuild=10, Refit=0.01})
# Adjust these sliders and observe the result
# Adjust these sliders and observe the result
custom_preview_3 = CustomPreview(
    Geometry=loft_3,
    Material={diffuse=RGB(221, 160, 221), emission=RGB(66, 48, 66), shine=0.5, specular=RGB(255, 255, 255), transparency=0})

# ----
vector_2pt = Vector2Pt(PointA=point_3, PointB=construct_point, Unitize=False)  # -> Vector, Length
move_7 = Move(Geometry=loft_3, Motion=vector_2pt.Vector)  # -> Geometry, Transform
custom_preview_4 = CustomPreview(Geometry=move_7.Geometry, Material=ColourSwatch(SwatchColor=RGB(196, 104, 104)))

# ---- group: Spiral
number_slider_13 = Slider(80, range=0..200)
number_slider_14 = Slider(8.376, range=0..100)
point_4 = Point(Point(80.37932095, -2261.722126, 0))
pi_4 = Pi(Factor=number_slider_4)
offset_7 = Slider(2.875, range=0..10)
offset_8 = Slider(9.858, range=0..10)
range_7 = Range(Domain=pi_4, Steps=number_slider_13)
panel_4 = Panel(range_7)
point_polar_7 = PointPolar(BasePlane=point_4, XYAngle=range_7, ZAngle=0, Offset=number_slider)
point_polar_8 = PointPolar(BasePlane=point_4, XYAngle=range_7, ZAngle=0, Offset=number_slider_3)
range_8 = Range(Domain=division, Steps=number_slider_13)
unit_z_4 = UnitZ(Factor=range_8)
move_8 = Move(Geometry=point_polar_8, Motion=unit_z_4)  # -> Geometry, Transform
move_9 = Move(Geometry=point_polar_7, Motion=unit_z_4)  # -> Geometry, Transform
line_4 = Line(StartPoint=move_9.Geometry, EndPoint=move_8.Geometry)
loft_4 = Loft(Curves=line_4, Options={Adjust=False, Closed=False, LoftEnds=0, LoftSimp=0, LoftType=0, Rebuild=10, Refit=0.01})
custom_preview_5 = CustomPreview(
    Geometry=loft_4,
    Material={diffuse=RGB(221, 160, 221), emission=RGB(66, 48, 66), shine=0.5, specular=RGB(255, 255, 255), transparency=0})

# ----
vector_2pt_2 = Vector2Pt(PointA=point_4, PointB=construct_point_2, Unitize=False)  # -> Vector, Length
# 4x Pink inner cylinders
move_10 = Move(Geometry=loft_4, Motion=vector_2pt_2.Vector)  # -> Geometry, Transform
custom_preview_6 = CustomPreview(Geometry=move_10.Geometry, Material=ColourSwatch(SwatchColor=RGB(196, 104, 104)))

# ---- group: Spiral
number_slider_15 = Slider(80, range=0..200)
number_slider_16 = Slider(8.376, range=0..100)
point_5 = Point(Point(149.651599, -2292.277384, 0))
pi_5 = Pi(Factor=number_slider_4)
offset_9 = Slider(2.875, range=0..10)
offset_10 = Slider(9.858, range=0..10)
range_9 = Range(Domain=pi_5, Steps=number_slider_15)
panel_5 = Panel(range_9)
point_polar_9 = PointPolar(BasePlane=point_5, XYAngle=range_9, ZAngle=0, Offset=number_slider)
point_polar_10 = PointPolar(BasePlane=point_5, XYAngle=range_9, ZAngle=0, Offset=number_slider_3)
range_10 = Range(Domain=division, Steps=number_slider_15)
unit_z_5 = UnitZ(Factor=range_10)
move_11 = Move(Geometry=point_polar_10, Motion=unit_z_5)  # -> Geometry, Transform
move_12 = Move(Geometry=point_polar_9, Motion=unit_z_5)  # -> Geometry, Transform
line_5 = Line(StartPoint=move_12.Geometry, EndPoint=move_11.Geometry)
loft_5 = Loft(Curves=line_5, Options={Adjust=False, Closed=False, LoftEnds=0, LoftSimp=0, LoftType=0, Rebuild=10, Refit=0.01})
custom_preview_7 = CustomPreview(
    Geometry=loft_5,
    Material={diffuse=RGB(221, 160, 221), emission=RGB(66, 48, 66), shine=0.5, specular=RGB(255, 255, 255), transparency=0})

# ----
vector_2pt_3 = Vector2Pt(PointA=point_5, PointB=construct_point_3, Unitize=False)  # -> Vector, Length
move_13 = Move(Geometry=loft_5, Motion=vector_2pt_3.Vector)  # -> Geometry, Transform
custom_preview_8 = CustomPreview(Geometry=move_13.Geometry, Material=ColourSwatch(SwatchColor=RGB(196, 104, 104)))

# ---- group: Spiral
number_slider_17 = Slider(80, range=0..200)
number_slider_18 = Slider(8.376, range=0..100)
point_6 = Point(Point(-39.80031057, -2311.879617, 0))
pi_6 = Pi(Factor=number_slider_4)
offset_11 = Slider(8.076, range=0..10)
offset_12 = Slider(9.858, range=0..10)
range_11 = Range(Domain=pi_6, Steps=number_slider_17)
panel_6 = Panel(range_11)
point_polar_11 = PointPolar(BasePlane=point_6, XYAngle=range_11, ZAngle=0, Offset=number_slider)
point_polar_12 = PointPolar(BasePlane=point_6, XYAngle=range_11, ZAngle=0, Offset=number_slider_3)
range_12 = Range(Domain=number_slider_5, Steps=number_slider_17)
unit_z_6 = UnitZ(Factor=range_12)
move_14 = Move(Geometry=point_polar_12, Motion=unit_z_6)  # -> Geometry, Transform
move_15 = Move(Geometry=point_polar_11, Motion=unit_z_6)  # -> Geometry, Transform
line_6 = Line(StartPoint=move_15.Geometry, EndPoint=move_14.Geometry)
loft_6 = Loft(Curves=line_6, Options={Adjust=False, Closed=False, LoftEnds=0, LoftSimp=0, LoftType=0, Rebuild=10, Refit=0.01})
custom_preview_9 = CustomPreview(
    Geometry=loft_6,
    Material={diffuse=RGB(221, 160, 221), emission=RGB(66, 48, 66), shine=0.5, specular=RGB(255, 255, 255), transparency=0})

number_slider_19 = Slider(80, range=0..200)
number_slider_20 = Slider(8.376, range=0..100)
point_7 = Point(Point(-1.013738712, -2155.116213, 0))
pi_7 = Pi(Factor=number_slider_4)
offset_13 = Slider(2.875, range=0..10)
offset_14 = Slider(9.858, range=0..10)
range_13 = Range(Domain=pi_7, Steps=number_slider_19)
panel_7 = Panel(range_13)
point_polar_13 = PointPolar(BasePlane=point_7, XYAngle=range_13, ZAngle=0, Offset=number_slider)
point_polar_14 = PointPolar(BasePlane=point_7, XYAngle=range_13, ZAngle=0, Offset=number_slider_3)
range_14 = Range(Domain=division, Steps=number_slider_19)
unit_z_7 = UnitZ(Factor=range_14)
move_16 = Move(Geometry=point_polar_14, Motion=unit_z_7)  # -> Geometry, Transform
move_17 = Move(Geometry=point_polar_13, Motion=unit_z_7)  # -> Geometry, Transform
line_7 = Line(StartPoint=move_17.Geometry, EndPoint=move_16.Geometry)
loft_7 = Loft(Curves=line_7, Options={Adjust=False, Closed=False, LoftEnds=0, LoftSimp=0, LoftType=0, Rebuild=10, Refit=0.01})
custom_preview_10 = CustomPreview(
    Geometry=loft_7,
    Material={diffuse=RGB(221, 160, 221), emission=RGB(66, 48, 66), shine=0.5, specular=RGB(255, 255, 255), transparency=0})

# ----
vector_2pt_4 = Vector2Pt(PointA=point_7, PointB=construct_point_4, Unitize=False)  # -> Vector, Length
move_18 = Move(Geometry=loft_7, Motion=vector_2pt_4.Vector)  # -> Geometry, Transform
custom_preview_11 = CustomPreview(Geometry=move_18.Geometry, Material=ColourSwatch(SwatchColor=RGB(232, 74, 74)))

vector_2pt_5 = Vector2Pt(PointA=point_2, PointB=construct_point_5, Unitize=False)  # -> Vector, Length
# Bright red inner cylinder
move_19 = Move(Geometry=loft_2, Motion=vector_2pt_5.Vector)  # -> Geometry, Transform
custom_preview_12 = CustomPreview(Geometry=move_19.Geometry, Material=ColourSwatch(SwatchColor=RGB(207, 0, 0)))

vector_2pt_6 = Vector2Pt(PointA=point, PointB=construct_point_6, Unitize=False)  # -> Vector, Length
# White inner cylinder
move_20 = Move(Geometry=loft, Motion=vector_2pt_6.Vector)  # -> Geometry, Transform
custom_preview_13 = CustomPreview(Geometry=move_20.Geometry, Material=ColourSwatch(SwatchColor=RGB(240, 213, 213)))

count_7 = Slider(10, range=3..100)

# ---- group: Normalising
series_7 = Series(Start=0, Step=1, Count=count_7)
expression_19 = Expression(i=series_7, n=count_7, Expression="i / ( n - 1 )")

# ----
expression_20 = Expression(r=radius_4, c=cycles_4, t=expression_19, p=phase, Expression="r * cos( 2 * π * c * t + p )")
expression_21 = Expression(r=radius_4, c=cycles_4, t=expression_19, p=phase, Expression="r * sin( 2 * π * c * t + p )")
construct_point_7 = ConstructPoint(XCoordinate=expression_20, YCoordinate=expression_21, ZCoordinate=0)

vector_2pt_7 = Vector2Pt(PointA=point_6, PointB=construct_point_7, Unitize=False)  # -> Vector, Length
# Black inner cylinder
move_21 = Move(Geometry=loft_6, Motion=vector_2pt_7.Vector)  # -> Geometry, Transform
custom_preview_14 = CustomPreview(Geometry=move_21.Geometry, Material=ColourSwatch(SwatchColor=RGB(0, 0, 0)))
