# Grasshopper definition Parametric Design Project 3D Model Grasshopper code.gh (Grasshopper 1.0.7)

# ----
# Parameters
# Controls
# Variation Analysis
# Selected Parameters:
# 1. s: 1           k: 1       2. s: 1           k: 5       3. s: 1            k: 50
# 4. s: 6.5        k: 1       5. s: 6.5        k: 5      6. s: 6.5        k: 50
# 7. s: 10.995  k: 1      8. s: 10.995  k: 5      9. s: 10.995  k: 50
# Unique numbers for variable s:
# 10.995
# 12.5
variable_s = Slider(1, range=0..100)
variable_k = Slider(1, range=0..50)

# ---- group: Creates a surface of points with wave pattern
ny = Slider(45, range=2..90)
step = Slider(1, range=0..100)
start = Slider(0, range=0..100)
nx = Slider(45, range=2..90)
step_2 = Slider(1, range=0..100)
# http://asd.courses.sutd.edu.sg/cdt/data-landscapes/2/
# 
# SUTD. “Computational Thinking and Design, Data Landscapes
# Complex Patterns” ASD course notes. 2020
start_2 = Slider(0, range=0..100)
series = Series(Start=start_2, Step=step_2, Count=nx)
series_2 = Series(Start=start, Step=step, Count=ny)
construct_point = ConstructPoint(XCoordinate=series, YCoordinate=graft(series_2), ZCoordinate=0)
deconstruct = Deconstruct(Point=construct_point)  # -> XComponent, YComponent, ZComponent
ghpython_script = GhPythonScript(x=deconstruct.XComponent, y=deconstruct.YComponent, k=variable_k, s=variable_s)  # -> out, z
# ---------- ghpython_script: Python ----------
__author__ = "Jet Wei"
__version__ = "2023.10.02"

import rhinoscriptsyntax as rs
from math import *
z = sin(x) + k * sin(y * s)
# ---------- end ghpython_script ----------
construct_point_2 = ConstructPoint(XCoordinate=deconstruct.XComponent, YCoordinate=deconstruct.YComponent, ZCoordinate=ghpython_script.z)
surface_from_points = SurfaceFromPoints(Points=flatten(construct_point_2), UCount=ny, Interpolate=False)

# ---- group: Incorporating a ripple effect/modifying the wave pattern further to create more interesting designs
# Default graph parameter
# Default parameter: 7
pull_point = PullPoint(Point=construct_point_2, Geometry=surface_from_points, ClosestOnly=True)  # -> ClosestPoint, Distance
bounds = Bounds(Numbers=flatten(pull_point.Distance))
remap_numbers = RemapNumbers(Value=pull_point.Distance, Source=bounds, Target=Domain(0, 1))  # -> Mapped, Clipped
unit_z = UnitZ(Factor=1)
# https://www.youtube.com/watch?v=nwyZ8iephSE
# 
# architutors
graph_mapper = GraphMapper(
    remap_numbers.Mapped,
    x0=0,
    x1=1,
    y0=0,
    y1=1,
    container_name="Sine",
    Equation_px=[0, 0.2419759184],
    Equation_py=[0, 0.9879225492])
multiplier_m = Slider(7, range=0..10)
multiplication = Multiplication(A=graph_mapper, B=multiplier_m)
amplitude = Amplitude(Vector=unit_z, Amplitude=multiplication)
move = Move(Geometry=construct_point, Motion=amplitude)  # -> Geometry, Transform
addition = Addition(A=ny)
graph_mapper_2 = GraphMapper(x0=0, x1=1, y0=0, y1=1, container_name="Sine", Equation_px=[0, 0.2419759184], Equation_py=[0, 0.9879225492])
surface_from_points_2 = SurfaceFromPoints(Points=flatten(move.Geometry), UCount=addition, Interpolate=False)
custom_preview = CustomPreview(Geometry=surface_from_points_2, Material=ColourSwatch(SwatchColor=RGB(64, 152, 207)))

# ---- group: Creating the base
construct_point_3 = ConstructPoint(XCoordinate=Slider(22, range=0..100), YCoordinate=Slider(22, range=0..100), ZCoordinate=Slider(3, range=0..100))
center_box = CenterBox(Base=construct_point_3, X=Slider(22.3, range=0..100), Y=Slider(22.3, range=0..100), Z=Slider(3, range=0..100))
custom_preview_2 = CustomPreview(Geometry=center_box, Material=ColourSwatch(SwatchColor=RGB(64, 152, 207)))

# ---- group: Extrusion
# This number slider sets the amount of
# extrusion of the 3D model
number_slider = Slider(4, range=0..100)
unit_z_2 = UnitZ(Factor=number_slider)
extrude = Extrude(Base=surface_from_points_2, Direction=unit_z_2)
custom_preview_3 = CustomPreview(Geometry=extrude, Material=ColourSwatch(SwatchColor=RGB(64, 152, 207)))

# ---- group: Surface area calculator
# Surface area must be less than 95mm x 95mm = 9025mm^2
# http://asd.courses.sutd.edu.sg/cdt/data-landscapes/3/
# 
# SUTD. “Computational Thinking and Design, Data Landscapes, Parametric Variations” ASD course notes. 2020
area = Area(Geometry=surface_from_points_2)  # -> Area, Centroid
panel = Panel(area.Area)
